vi "Main.gviweb"   [LabVIEW NXG 2.0.0]
panel indicators:
  "Temperature": i32
  "Digital Input Data": bool[]
  "Voltage RMS": i32
  "Frequency": i32
types:
  T1 = cluster{"TemperatureData": i32, "DIData": bool[], "VRMSData": i32, "FreqData": i32}
uses:
  NI::HTTP::GET.gvi
diagram:
  # Place setup code before the loop. For example, perform initial data communication and wire the results into the loop.
  # Top-Level WebVIs usually contain a While Loop that never stops so that they can continue running as long as the web page is open in the user's web browser.
  while {
    call "GET.gvi"(url="http://127.0.0.1:8001/WebAPIv1/GetData") -> (body=w1)
    # Inside the loop, place code that responds to user input and communicates with data sources over the network.
    Unflatten From JSON(JSON string=w1, type and defaults=T1 {all zero or empty}) -> (value=w2)
    Property Node(instance in=w2) -> ("TemperatureData"=w3, "DIData"=w4, "VRMSData"=w5, "FreqData"=w6)
    $Temperature <- w3
    $"Digital Input Data" <- w4
    $"Voltage RMS" <- w5
    $Frequency <- w6
    Wait(time to wait=50)
    stop if FALSE
  }
